# Grasshopper definition test_read_config.ghx (Grasshopper 1.0.7)

config_firebase_from_options = GhPythonScript(project_id="asd")  # -> config
# ---------- config_firebase_from_options: Python ----------
config = {
    "apiKey": api_key,
    "authDomain": auth_domain,
    "databaseURL": database_url,
    "projectId": project_id,
    "storageBucket": storage_bucket,
    "messagingSenderId": messaging_sender_id,
    "appId": app_id,
    "measurementId": measurement_id
}

config = config.items()
# ---------- end config_firebase_from_options ----------
config_firebase = GhPythonScript()  # -> config
# ---------- config_firebase: Python ----------
import os
import json

if not filename:
    canvas = ghenv.Component.OnPingDocument()
    folder = os.path.dirname(canvas.FilePath)
    filename = os.path.join(folder, "firebase_config.json")

if not os.path.exists(filename):
    raise Exception("Configuration file not found: {}".format(filename))

with open(filename, "r") as f:
    config = json.load(f)
# ---------- end config_firebase ----------
config_firebase_2 = GhPythonScript(config=config_firebase_from_options)  # -> config; inputs config: list
# ---------- config_firebase_2: Python ----------
import os
import json

if not filename:
    canvas = ghenv.Component.OnPingDocument()
    folder = os.path.dirname(canvas.FilePath)
    filename = os.path.join(folder, "firebase_config.json")

config = dict(config)
with open(filename, "w") as f:
    json.dump(config, f)
    print(filename)
    print(config)
# ---------- end config_firebase_2 ----------
init_to_firebase = GhPythonScript(X=config_firebase)  # -> Out, A
